# Grasshopper definition Ants Gray Scott Component.gh (Grasshopper 0.9.75)
# plug-ins: Ants

number_slider = Slider(50, range=5..50)
grgph = CreateGraphOfAGrid(Rows=number_slider, NumberOfColumns=number_slider, ConnectCorners=False)
gphpts = GraphToNodes(SpatialGraph=grgph)
cluster = Cluster(pts=gphpts)  # -> nmlzd_pts_2, width_2, height_2
image = ImageSampler(
    cluster.nmlzd_pts_2,
    FilePath="C:\Users\ksteinfe\Desktop\great scott.bmp",
    Filter="Value",
    Interpolate=False,
    Umax=1,
    Umin=0,
    Vmax=1,
    Vmin=0,
    Wrap=1)

cluster_2 = Cluster_2(pattern=image, true_val="0.25", false_val="0.0")
v_values = Number(cluster_2)

cluster_3 = Cluster_2(pattern=image, true_val="0.5", false_val="1.0")
u_values = Number(cluster_3)

number_slider_2 = Slider(490, range=0..1000)
gray_scott = GrayScottEngine(
    SpatialGraph=grgph,
    UValues=u_values,
    VValues=v_values,
    FCoefficient=0.023,
    KCoefficient=0.077,
    DuCoefficient=0.095,
    DvCoefficient=0.03,
    Timestep=Slider(2, range=0..10),
    Generations=Slider(600, range=5..1000))  # -> WU, WV
genvals = GetValues(AWorld=gray_scott.WU, Generation=number_slider_2)
genvals_2 = GetValues(AWorld=gray_scott.WV, Generation=number_slider_2)
cir = Circle(Plane=gphpts, Radius=Slider(0.41, range=0.1..1.1))
gradient = Gradient(LowerLimit=0, UpperLimit=1, Parameter=genvals, stops=[0: RGB(255, 255, 255), 1: RGB(220, 0, 40)])
gradient_2 = Gradient(LowerLimit=0, UpperLimit=1, Parameter=genvals_2, stops=[0: RGB(255, 255, 255), 1: RGB(0, 0, 255)])
bar_graph = BarGraph(genvals, BarColor=RGB(255, 0, 90))
divide = DivideCurve(Curve=cir, Count=10, Kinks=False)  # -> Points, Tangents, Parameters
width = Number(cluster.width_2)
del = DelaunayMesh(Points=divide.Points, Plane=PlaneXY(0, 0, 0))  # -> flatten(Mesh)
bar_graph_2 = BarGraph(genvals_2, BarColor=RGB(255, 0, 90))
multiplication = Multiplication(A=Slider(1.09, range=1..1.5), B=width)
X = UnitX(Factor=multiplication)
move = Move(Geometry=del, Motion=X)  # -> Geometry, Transform
preview = CustomPreview(Geometry=del, Shader=gradient)
preview_2 = CustomPreview(Geometry=move.Geometry, Shader=gradient_2)

# ==== cluster Cluster
pts = ClusterInput()
pts_2 = Point(pts)
bnd = Bounds2D(Coordinates=pts_2)
pdecon = Deconstruct(Point=pts_2)  # -> XComponent, YComponent, ZComponent
dedom2 = DeconstructDomain²(Domain=bnd)  # -> UComponent, VComponent
remap = RemapNumbers(Value=pdecon.XComponent, Source=dedom2.UComponent, Target=Domain(0, 1))  # -> Mapped, Clipped
remap_2 = RemapNumbers(Value=pdecon.YComponent, Source=dedom2.VComponent, Target=Domain(0, 1))  # -> Mapped, Clipped
dedomain = DeconstructDomain(Domain=dedom2.UComponent)  # -> Start, End
dedomain_2 = DeconstructDomain(Domain=dedom2.VComponent)  # -> Start, End
subtraction = Subtraction(A=dedomain.End, B=dedomain.Start)
subtraction_2 = Subtraction(A=dedomain_2.End, B=dedomain_2.Start)
pt = ConstructPoint(XCoordinate=remap.Mapped, YCoordinate=remap_2.Mapped, ZCoordinate=0)
height = Number(subtraction_2)
width = Number(subtraction)
nmlzd_pts = Point(pt)
width_2 = ClusterOutput(width)
height_2 = ClusterOutput(height)
nmlzd_pts_2 = ClusterOutput(nmlzd_pts)

# ==== cluster Cluster_2
pattern = ClusterInput()
false_val = ClusterInput()
true_val = ClusterInput()
pattern_2 = Boolean(pattern)
false_val_2 = Number(false_val)
true_val_2 = Number(true_val)
lng = ListLength(List=pattern_2)
dup = DuplicateData(Data=true_val_2, Number=lng, Order=True)
dup_2 = DuplicateData(Data=false_val_2, Number=lng, Order=True)
p_n_c = PickNChoose(Pattern=pattern_2, Stream0=dup_2, Stream1=dup)
R = ClusterOutput(p_n_c)
