# Grasshopper definition Selection_Tester.gh (Grasshopper 0.9.72)
# plug-ins: Ants

test = Panel("""h_val =  any([v==2.0 for v in n_vals])
print h_idx, n_vals, h_val""")
number_slider = Slider(3, range=0..10)
multiplication = Multiplication(A=number_slider, B=number_slider)
random = Random(Range=Domain(0, 2), Number=multiplication, Seed=2)
test_2 = Panel("print h_idx, n_vals,\"yo!\"")
round = Round(Number=random)  # -> Nearest, Floor, Ceiling
grgph = CreateGraphOfAGrid(Rows=number_slider, NumberOfColumns=number_slider, ConnectCorners=Toggle(False))
gphln = GraphToEdges(SpatialGraph=grgph)
ants = AntsEngine2(SpatialGraph=grgph, SelectionScript=test, EvalScript=test_2, Value=round.Ceiling, Generations=Slider(10, range=0..10))  # -> Console, AWorld
panel = Panel(ants.Console)
