# Grasshopper definition antworld_test_nr.gh (Grasshopper 0.9.72)
# plug-ins: Decodes Python Interpreter, Ants

# creates a border: if len(n_vals)==4: h_val = 0.5
# elif len(n_vals)==2: h_val = 0.5
# else: h_val = 0.1
# print h_val
# creates a border: if len(n_vals) < 4: h_val = 0.5
# elif len(n_vals)< 8: h_val = 1.0
# else: h_val = 10.0
# print h_val
diagnostic = Panel("""h_val = h_val
print h_val, len(n_vals)""")
# random: import random
# h_val = random.randint(0,1)
game_of_life = Panel("""val_on = 1.0
val_off = 0.0
count = 0

# for each cell in the neighborhood:
for i in n_vals:
    # if cell is True:
    if i >= val_on: 
        count += 1 # count it
        
# if home cell is True:
if h_val >= val_on:
    # if less than 2 or more than 3 neighbors are True:
    if (count < 2) or (count >3) :
        # this cell will be False in the next generation
        h_val = val_off
    # else:
    else:
        # this cell will be True in the next generation
        h_val = val_on
# else the home cell is False:
else:
    # if exactly 3 neighbors are True:
    if (count == 3):
        # this cell will be True in the next generation
        h_val = val_on
    else:
        # else this cell will be False in the next generation
        h_val = val_off

print h_val, count, n_vals""")
func_a = Text(diagnostic)
# test: print h_idx, n_vals
# if any([v>3.0 for v in n_vals]):
#     h_val = 1
# else:
#     h_val = 0
func_b = Text(game_of_life)
range = Range(Domain=Domain(0, 8), Steps=8)
decodes = DecodesPythonScript()  # -> console, a
# ---------- decodes: Python ----------
a.put([0,0,0,1,1,1,0,0,0])
# ---------- end decodes ----------
panel = Panel("0.05")
func_a_2 = Text(func_a)
gridworld = AntsGridWorld(Rows=Slider(3, range=2..30), NumberOfColumns=Slider(3, range=2..30), Value=decodes.a, ConnectCorners=Toggle(True))
func_b_2 = Text(func_b)
number_slider = Slider(0, range=0..10)
ants = AntsCompoent(AWorld=gridworld, Script=func_a_2, Generations=Slider(1, range=0..10))  # -> Console, AWorld
getedges = GetEdges(AWorld=gridworld)
panel_2 = Panel(ants.AWorld)
ants_2 = AntsCompoent(AWorld=ants.AWorld, Script=func_b_2, Generations=Slider(10, range=0..10))  # -> Console, AWorld
panel_3 = Panel(ants.Console)
path = ConstructPath(Indices=number_slider)
genvals = GenerationValues(AWorld=ants_2.AWorld, Generation=number_slider)
branch = TreeBranch(Path=path, MaintainPaths=True)
panel_4 = Panel(ants_2.AWorld)
panel_5 = Panel(ants_2.Console)
cir = Circle(Plane=PlaneXY(0, 0, 0), Radius=expr("x/2", branch))
panel_6 = Panel(genvals)
