# Grasshopper definition graph_testers.gh (Grasshopper 0.9.72)
# plug-ins: Ants

number_slider = Slider(10, range=0..10)
graphbygrid = CreateGraphOfAGrid(Rows=number_slider, NumberOfColumns=number_slider, ConnectCorners=Toggle(False))
ants = AntsCompoent(SpatialGraph=graphbygrid, Script="h_val = h_val -1", Value=Slider(0, range=0..100), Generations=Slider(5, range=0..10))  # -> Console, AWorld
sgraph = SpatialGraph()
getnodes = GetNodes(SpatialGraph=graphbygrid)
graphtoedges = GraphToEdges(SpatialGraph=graphbygrid)
