# Grasshopper definition maze_solver.gh (Grasshopper 0.9.72)
# plug-ins: Ants

# ----
# a
pixel_width = Panel("19")
pixel_height = Panel("19")
panel = Panel("create starting position")
pixel_height_2 = Integer(pixel_height)
pixel_width_2 = Integer(pixel_width)

maze_solver = Panel("""val_corr = 1.0
val_wall = 0.0
count = 0

# for each cell in the neighborhood:
for i in n_vals:
    # if cell is True:
    if i == val_wall: 
        count += 1 # count it

if (len(n_vals) > 3) and (h_val == val_corr):
    # if cell is True:
    if count > 2: 
        h_val = val_wall

print h_val, count, n_vals""")

pixel_height_3 = Integer(pixel_height)
pixel_width_3 = Integer(pixel_width)
cluster = Cluster(B_2=pixel_width_3, B=pixel_height_3)

pixel_width_4 = Integer(pixel_width)
pixel_height_4 = Integer(pixel_height)

image = ImageSampler(
    cluster,
    FilePath="C:\Users\Ned Reifenstein\Documents\GitHub\ants\gh\images\drmaze4.jpg",
    Filter="Red",
    Interpolate=False,
    Umax=19,
    Umin=1,
    Vmax=19,
    Vmin=1,
    Wrap=1)
func_b = Text(maze_solver)
round = Round(Number=image)  # -> Nearest, Floor, Ceiling
panel_2 = Panel(round.Nearest)
bitmap = Data(round.Nearest)
pixel_height_5 = Integer(pixel_height)
pixel_width_5 = Integer(pixel_width)
grgph = CreateGraphOfAGrid(Rows=pixel_width_5, NumberOfColumns=pixel_height_5, ConnectCorners=Toggle(False))
bitmap_2 = Data(round.Nearest)
func_b_2 = Text(func_b)
_0 = Slider(45, range=0..100)
num = Number(bitmap_2)
gphpts = GraphToNodes(SpatialGraph=grgph)
gphln = GraphToEdges(SpatialGraph=grgph)
ants = AntsComponent(SpatialGraph=grgph, Script=func_b_2, Value=num, Generations=_0)  # -> Console, AWorld
panel_3 = Panel(ants.Console)
genvals = GenerationValues(AWorld=ants.AWorld, Generation=Slider(45, range=0..100))
genvals_2 = GenerationValues(AWorld=ants.AWorld, Generation=Slider(0, range=0..100))
equals = Equality(FirstNumber=genvals, SecondNumber=0)  # -> Equality, Inequality
equals_2 = Equality(FirstNumber=genvals_2, SecondNumber=0)  # -> Equality, Inequality
cull = CullPattern(List=gphpts, CullPattern=equals.Inequality)
cull_2 = CullPattern(List=gphpts, CullPattern=equals_2.Equality)
box = CenterBox(Base=cull, X=".5", Y=".5", Z=".5")
box_2 = CenterBox(Base=cull_2, X=".5", Y=".5", Z=".5")
col = Colour(RGB(156, 199, 171))
preview = CustomPreview(Geometry=box, Shader=col)

# ==== cluster Cluster
B = ClusterInput()
B_2 = ClusterInput()
dom = ConstructDomain(DomainStart=1, DomainEnd=B)
dom_2 = ConstructDomain(DomainStart=1, DomainEnd=B_2)
range = Range(Domain=dom, Steps=dom)
range_2 = Range(Domain=dom_2, Steps=dom_2)
crossref = CrossReference(ListA=range_2, ListB=range, CrossMode=1)  # -> ListA, ListB
pt = ConstructPoint(XCoordinate=crossref.ListA, YCoordinate=crossref.ListB, ZCoordinate=0)
pt_2 = ClusterOutput(pt)
